# Grasshopper definition Double_Material-Extruder_Printing_Information.gh (Grasshopper 1.0.7)

# ---- group: Inputs
final_geometry = Mesh(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)
layer_height_mm = Panel("1")
number_slider = Slider(0.05, range=0..1)

# ----
mesh = Mesh(final_geometry)
contour = Contour(Shape=mesh, Point=Point(0, 0, 0), Direction=Vector(0, 0, 1), Distance=layer_height_mm)  # -> flatten(Contours)
mesh_2 = Mesh(mesh)
contour_crvs = Curve(contour)
panel = Panel("""True
False""")
dispatch = Dispatch(List=contour_crvs, DispatchPattern=panel)  # -> ListA, ListB
flip = FlipCurve(Curve=dispatch.ListB)  # -> Curve, Flag
panel_2 = Panel("""0
1""")
weave = Weave(Pattern=panel_2, Stream0=dispatch.ListA, Stream1=flip.Curve, NullGaps=False)
crv = Curve(weave)

# ---- group: Simplify and explode
redpline = Reduce(Polyline=crv, Tolerance=number_slider)  # -> Polyline, Reduction
explode = Explode(Curve=redpline.Polyline, Recursive=True)  # -> Segments, Vertices

# ----
mesh_3 = Mesh(mesh_2)
pt = Point(explode.Vertices)

# ---- group: Material proportion from Mesh Color
meshcp = MeshClosestPoint(Point=pt, Mesh=mesh_3)  # -> Point, Index, Parameter

# ---- group: Material proportion from Mesh Color / Mesh Eval Bug correction
meval = MeshEval(Mesh=mesh_3, Parameter=meshcp.Parameter)  # -> Point, Normal, Colour
cluster = Cluster(mesh=mesh_3, data=meshcp.Parameter)

# ---- group: Material proportion from Mesh Color (continued)
col = Colour(cluster)
argb = SplitARGB(Colour=col)  # -> Alpha, Red, Green, Blue

# ---- group: Outputs
points = Point(pt)
material_proportions = Number(argb.Red)

# ==== cluster Cluster
mesh = ClusterInput()
data = ClusterInput()
mesh_2 = Mesh(mesh)
data_2 = Data(data)
hack = VBScript(m=mesh_2)  # -> out, A; inputs m: Mesh
# ---------- hack: VB ----------
    If m IsNot Nothing Then
      Dim msh As New mesh
      Dim fcs As Rhino.Geometry.Collections.MeshFaceList
      Dim verts As Rhino.Geometry.Collections.MeshVertexList
      Dim nrms As rhino.Geometry.Collections.MeshVertexNormalList
      Dim clrs As Rhino.Geometry.Collections.MeshVertexColorList

      fcs = m.Faces
      verts = m.Vertices
      nrms = m.Normals
      clrs = m.VertexColors

      For i As Integer = 0 To verts.count() - 1 Step 1
        Dim x As New Vector3f (clrs.item(i).R, clrs.item(i).G, clrs.item(i).B)
        nrms.SetNormal(i, x)
      Next
      msh.Vertices.AddVertices(verts.toarray())
      msh.Faces.AddFaces(fcs.ToArray())
      msh.Normals.AddRange(nrms.ToArray())
      A = msh
    End If
# ---------- end hack ----------
meval = MeshEval(Mesh=hack.A, Parameter=data_2)  # -> Point, Normal, Colour
devec = DeconstructVector(Vector=meval.Normal)  # -> XComponent, YComponent, ZComponent
rgb = ColourRGB(Alpha=255, Red=devec.XComponent, Green=devec.YComponent, Blue=devec.ZComponent)
col = Colour(rgb)
col_2 = ClusterOutput(col)
